# Dynamo custom node Mirror.Parameter.dyf (Dynamo 1.3.0.875)
# category: My Custom Nodes
# In revit system, mirror is only able to mirror model geometry, but not paprameter. For instance, when i mirror the outlet design,  I still need to manually opposite the graphic parameter for elements symbols to complete the workflow.  The node is aim to make up for the Revit mirror capability,

Elements = Input()
Parameter = Input()
set_mirror_parameter = Python(IN[0]=Elements, IN[1]=Parameter)
# ---------- set_mirror_parameter.python (55 lines) ----------
"""
__author__ = 'Soulian Li'
__Gmail__ = 'liang.li1104@gmail.com'
__version__ = '1.0.0'
__Date__ = '07.04.20'

"""

import clr
import sys
# import Revit API
clr.AddReference('RevitAPI')
from Autodesk.Revit.DB import *
# import Revit API UI
clr.AddReference('RevitAPIUI')
from Autodesk.Revit.UI import *
# import Revit Services 
clr.AddReference('RevitServices')
import RevitServices
from RevitServices.Persistence import DocumentManager
from RevitServices.Transactions import TransactionManager 
# import ProtoGeometry 
clr.AddReference('ProtoGeometry')
from Autodesk.DesignScript.Geometry import *
# get Revit's current Document file.
doc = DocumentManager.Instance.CurrentDBDocument
# get the current application 
app = DocumentManager.Instance.CurrentUIApplication.Application
#get the user interface application 
uiapp = DocumentManager.Instance.CurrentUIApplication
app = uiapp.Application


# Dynamo input
elements = IN[0]
Mparameter = IN[1]

# Empty list
value = []
# loop over elements 
for e in UnwrapElement(elements):
    # look up parameter
    p = e.GetParameters(Mparameter)
    # start Revit transaction
    TransactionManager.Instance.EnsureInTransaction(doc)
    
    # look up parameter
    for i in p:
    	# set parameter. 
    	ii = i.AsDouble()
    	value.append(ii)
    	i.Set(-1*ii)
    	# end Revit transaction 
    TransactionManager.Instance.TransactionTaskDone()
OUT = map(lambda x: x*-304.8, value)
# ----------------------------------------
Mirror_Values = Output(set_mirror_parameter)
