# Dynamo graph SetMirrorParameter.dyn (Dynamo 1.3.4.6666)

select_model_elements = DSModelElementsSelection()  # 9 picked in the model
code_block = CodeBlock { "Offset Symbol Along Wall"; "Offset Symbol Off Wall"; }
parameter = Custom[Mirror.Parameter](Elements=select_model_elements, Parameter=code_block.out0)  # In revit system, mirror is only able to mirror model geometry, but not paprameter. For instance, when i mirror the outlet design, I still need to manually opposite the graphic parameter for elements symbols to complete the workflow. The node is aim to make up for the Revit mirror capability,
